# Grasshopper definition 190310.gh (Grasshopper 1.0.7)
# plug-ins: BH.UI.Grasshopper

# ----
# Pull Topography from Mongo
panel = Panel("Vitboken")
mongoadapter = MongoAdapter(
    ServerName="mongodb://localhost",
    Port=27017,
    DatabaseName=panel,
    CollectionName="Topography",
    UseHistory=True,
    Component="{ ..ctor")
pull = Pull(Adapter=mongoadapter, Active=Toggle(True), Component="{ .Pull")
explode = Explode(Object=pull, Component="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")  # -> X, Y, Z
construct_point = ConstructPoint(XCoordinate=explode.X, YCoordinate=explode.Y, ZCoordinate=explode.Z)
negative = Negative(Value=Slider(1000, range=0..1000))
unit_z = UnitZ(Factor=negative)
delaunay_mesh = DelaunayMesh(Points=construct_point, Plane=PlaneXY(0, 0, 0))
move = Move(Geometry=delaunay_mesh, Motion=unit_z)  # -> Geometry, Transform

# ----
# Visualization!
surface = Surface(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)

# ----
# Lyktstolpar
curve = Curve([<curve referenced from the Rhino model> x498])
area = Area(Geometry=curve)  # -> Area, Centroid
clean_tree = CleanTree(RemoveNulls=True, RemoveInvalid=True, RemoveEmpty=False, Tree=area.Centroid)
project = Project(Geometry=clean_tree, Plane=PlaneXY(0, 0, 0))  # -> Geometry, Transform
unit_z_2 = UnitZ(Factor=1)
project_point = ProjectPoint(Point=project.Geometry, Direction=unit_z_2, Geometry=surface)  # -> Point, Index
clean_tree_2 = CleanTree(RemoveNulls=True, RemoveInvalid=True, RemoveEmpty=False, Tree=project_point.Point)
number_slider = Slider(200, range=0..1000)
xy_plane = XYPlane(Origin=clean_tree_2)
rectangle = Rectangle(Plane=xy_plane, XSize=number_slider, YSize=number_slider, Radius=Slider(10, range=0..10))  # -> Rectangle, Length
unit_z_3 = UnitZ(Factor=Slider(10000, range=0..10000))
boundary_surfaces = BoundarySurfaces(Edges=rectangle.Rectangle)
unit_z_4 = UnitZ(Factor=Slider(200, range=0..1000))
move_2 = Move(Geometry=rectangle.Rectangle, Motion=unit_z_3)  # -> Geometry, Transform
extrude = Extrude(Base=boundary_surfaces, Direction=unit_z_3)
extrude_2 = Extrude(Base=move_2.Geometry, Direction=unit_z_4)
area_2 = Area(Geometry=extrude_2)  # -> Area, Centroid
custom_preview = CustomPreview(Geometry=extrude, Shader=ColourSwatch(SwatchColor=RGBA(89, 89, 89, 68)))
xy_plane_2 = XYPlane(Origin=area_2.Centroid)
scale_nu = ScaleNU(Geometry=extrude_2, Plane=xy_plane_2, ScaleX=Slider(7, range=0..10), ScaleY=1, ScaleZ=1)  # -> Geometry, Transform

# ----
# Get Adjacent buildings from OSM
number_slider_2 = Slider(7000, range=0..10000)
panel_2 = Panel("C:\Users\SESOFMAL\Downloads\map (2).osm")
unit_z_5 = UnitZ(Factor=number_slider_2)
polyline = PolyLine(Closed=False)
closed = Closed(Curve=polyline)  # -> Closed, Periodic
cull_pattern = CullPattern(List=polyline, CullPattern=closed.Closed)
point = Point(Point(253353.5563, 26892.09524, 0))
point_2 = Point(Point(729719.1774, 262764.7064, 0))
scale = Scale(Geometry=cull_pattern, Center=Point(0, 0, 0), Factor=Slider(1000, range=0..1000))  # -> Geometry, Transform
vector_2pt = Vector2Pt(PointA=point_2, PointB=point, Unitize=False)  # -> Vector, Length
move_3 = Move(Geometry=scale.Geometry, Motion=vector_2pt.Vector)  # -> Geometry, Transform
area_3 = Area(Geometry=move_3.Geometry)  # -> Area, Centroid
unit_z_6 = UnitZ(Factor=1)
project_point_2 = ProjectPoint(Point=area_3.Centroid, Direction=unit_z_6, Geometry=surface)  # -> Point, Index
vector_2pt_2 = Vector2Pt(PointA=area_3.Centroid, PointB=project_point_2.Point, Unitize=False)  # -> Vector, Length
move_4 = Move(Geometry=move_3.Geometry, Motion=vector_2pt_2.Vector)  # -> Geometry, Transform
extrude_3 = Extrude(Base=move_4.Geometry, Direction=unit_z_5)
cap_holes = CapHoles(Brep=extrude_3)
custom_preview_2 = CustomPreview(Geometry=cap_holes, Shader=ColourSwatch(SwatchColor=RGBA(148, 148, 148, 108)))

# ----
# Generation
timer = Timer(TimerInterval=2000)  # disabled
button = Button()

# ----
# Visualize total topography
colour_swatch = ColourSwatch(SwatchColor=RGBA(194, 194, 194, 68))
custom_preview_3 = CustomPreview(Geometry=surface, Shader=colour_swatch)

mesh = Mesh(simplify(Tree({0;0;0}: [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], {0;1;0}: [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], {0;2;0}: [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], {0;3;0}: [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], {0;4;0}: [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])))
construct_domain = ConstructDomain(DomainStart="2", DomainEnd="8")
mesh_2 = Mesh(simplify(mesh))

custom_preview_4 = CustomPreview(Geometry=mesh_2, Shader=ColourSwatch(SwatchColor=RGBA(39, 122, 45, 154)))

createboundary = CreateBoundary(M=mesh_2)

# ----
# Project Roads
curve_2 = Curve([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])
clean_tree_3 = CleanTree(RemoveNulls=True, RemoveInvalid=True, RemoveEmpty=False, Tree=curve_2)
project_2 = Project(Curve=clean_tree_3, Brep=surface, Direction=Vector(0, 0, 1))

garden_size = Panel("""16000
5995""")
corner_radius = Panel("8000")
min_nr_of_houses_in_row = Panel("3")
seednsimplify = SeedNsimplify(geo=createboundary)
crv = Curve(seednsimplify)
random = Random(Range=construct_domain, Number=1, Seed=2)  # -> flatten(Random)
lines = Lines(A=min_nr_of_houses_in_row, L=garden_size, C=crv, x=corner_radius)
crv_2 = Curve(flatten(crv))
data = Data(garden_size)
panel_3 = Panel()
round = Round(Number=random)  # -> Nearest, Floor, Ceiling
cluster = Cluster(
    rotangles=panel_3,
    midpts=panel_3,
    gardens=panel_3,
    garden_size=data,
    boundaries=crv_2,
    line=lines,
    maxamount=round.Floor)  # -> rotangles_2, midpts_2, houses, newregions, newlines
cluster_2 = Cluster(
    rotangles=cluster.rotangles_2,
    midpts=cluster.midpts_2,
    gardens=cluster.houses,
    garden_size=data,
    boundaries=cluster.newregions,
    line=cluster.newlines,
    maxamount=round.Floor)  # -> rotangles_2, midpts_2, houses, newregions, newlines
cluster_3 = Cluster(
    rotangles=cluster_2.rotangles_2,
    midpts=cluster_2.midpts_2,
    gardens=cluster_2.houses,
    garden_size=data,
    boundaries=cluster_2.newregions,
    line=cluster_2.newlines,
    maxamount=round.Floor)  # -> rotangles_2, midpts_2, houses, newregions, newlines
number_slider_3 = Slider(20, range=0..100)
number_slider_4 = Slider(1000, range=0..1000)
cluster_4 = Cluster(
    rotangles=cluster_3.rotangles_2,
    midpts=cluster_3.midpts_2,
    gardens=cluster_3.houses,
    garden_size=data,
    boundaries=cluster_3.newregions,
    line=cluster_3.newlines,
    maxamount=round.Floor)  # -> rotangles_2, midpts_2, houses, newregions, newlines
unit_z_7 = UnitZ(Factor=Slider(4000, range=0..10000))
cluster_5 = Cluster(
    rotangles=cluster_4.rotangles_2,
    midpts=cluster_4.midpts_2,
    gardens=cluster_4.houses,
    garden_size=data,
    boundaries=cluster_4.newregions,
    line=cluster_4.newlines,
    maxamount=round.Floor)  # -> rotangles_2, midpts_2, houses, newregions, newlines
cluster_6 = Cluster(
    rotangles=cluster_5.rotangles_2,
    midpts=cluster_5.midpts_2,
    gardens=cluster_5.houses,
    garden_size=data,
    boundaries=cluster_5.newregions,
    line=cluster_5.newlines,
    maxamount=round.Floor)  # -> rotangles_2, midpts_2, houses, newregions, newlines
unit_x = UnitX(Factor=Slider(10000, range=0..10000))
cluster_7 = Cluster(
    rotangles=cluster_6.rotangles_2,
    midpts=cluster_6.midpts_2,
    gardens=cluster_6.houses,
    garden_size=data,
    boundaries=cluster_6.newregions,
    line=cluster_6.newlines,
    maxamount=round.Floor)  # -> rotangles_2, midpts_2, houses, newregions, newlines
cull_i = CullIndex(List=cluster_7.midpts_2, Indices=0, Wrap=True)
cull_i_2 = CullIndex(List=cluster_7.houses, Indices=0, Wrap=True)
cull_i_3 = CullIndex(List=cluster_7.rotangles_2, Indices=0, Wrap=True)
geo = Geometry(mesh_2)
cluster_8 = Cluster_4(geo_2=cluster_7.newregions, geo=geo)
cluster_9 = Cluster_2(data_2=cull_i_2, geo=geo, data=Slider(6000, range=0..10000))  # -> B, P
lng = ListLength(List=cull_i_3)
customobject = CustomObject(
    point=cluster_9.P,
    angle=cull_i_3,
    nrHouses=lng,
    facadeOrient="4",
    Component="{ \"_t\" : \"System.Type\", \"Name\" : \"BH.oM.Base.CustomObject\" }")
merge = Merge(Data1=customobject)
explode_2 = Explode(Object=merge, Component="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")  # -> Point, Angle, NrHouses, FacadeOrient

# ----
# Push To Mongo
mongoadapter_2 = MongoAdapter(
    ServerName="mongodb://localhost",
    Port=27017,
    DatabaseName="project",
    CollectionName="bhomObjects",
    UseHistory=True,
    Component="{ ..ctor")
push = Push(Adapter=mongoadapter_2, Objects=cluster_9.P, Active=Toggle(False), Component="{ .Push")  # -> Objects, Success
# vitboken-shard-00-02-fckvg.mongodb.net:27017 --ssl --username erikforsberg95@hotmail.com --password Techdays-19 --authenticationDatabase admin
# mongoimport --host Vitboken-shard-0/vitboken-shard-00-00-fckvg.mongodb.net:27017,vitboken-shard-00-01-fckvg.mongodb.net:27017,vitboken-shard-00-02-fckvg.mongodb.net:27017 --ssl --username <USERNAME> --password <PASSWORD> --authenticationDatabase admin --db <DATABASE> --collection <COLLECTION> --type <FILETYPE> --file <FILENAME>
panel_4 = Panel(push.Objects)

# ----
# HouseE
panel_5 = Panel("HouseE")
# You must push an E house from Dynamo before you can use this!!!
panel_6 = Panel("HouseData")
mongoadapter_3 = MongoAdapter(
    ServerName="mongodb://localhost",
    Port=27017,
    DatabaseName=panel_6,
    CollectionName=panel_5,
    UseHistory=True,
    Component="{ ..ctor")
pull_2 = Pull(Adapter=mongoadapter_3, Active=Toggle(True), Component="{ .Pull")
explode_3 = Explode(Object=pull_2, Component="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")  # -> Item0, Item1
create_set = CreateSet(List=explode_3.Item0)  # -> Set, Map
member_index = MemberIndex(Set=explode_3.Item0, Member=create_set.Set)  # -> Index, Count
duplicate_data = DuplicateData(Data=graft(create_set.Set), Number=graft(member_index.Count), Order=True)
unflatten_tree = UnflattenTree(Tree=explode_3.Item1, Guide=duplicate_data)  # -> simplify(Tree)
join_curves = JoinCurves(Curves=unflatten_tree, Preserve=False)
discontinuity = Discontinuity(Curve=join_curves, Level=1)  # -> Points, Parameters
polyline_2 = PolyLine(Vertices=discontinuity.Points, Closed=Toggle(True))  # -> simplify(flatten(Polyline))
boundary_surfaces_2 = BoundarySurfaces(Edges=polyline_2)
custom_preview_5 = CustomPreview(Geometry=boundary_surfaces_2, Shader=ColourSwatch(SwatchColor=RGBA(164, 196, 130, 244)))

bounding_box = BoundingBox(Content=flatten(discontinuity.Points), Plane=PlaneXY(0, 0, 0), UnionBox=True)  # -> Box, Box_2
area_4 = Area(Geometry=boundary_surfaces_2)  # -> Area, Centroid
brep = Brep(bounding_box.Box)
area_5 = Area(Geometry=brep)  # -> Area, Centroid
larger_than = LargerThan(FirstNumber=area_4.Area, SecondNumber=Slider(5, range=0..10))  # -> LargerThan, OrEqualTo
bounds = Bounds(Numbers=area_4.Area)
cull_pattern_2 = CullPattern(List=boundary_surfaces_2, CullPattern=larger_than.LargerThan)

group = Group(Objects=cull_pattern_2)

scale_2 = Scale(Geometry=group, Center=area_5.Centroid, Factor=Slider(1000, range=0..1000))  # -> Geometry, Transform
move_5 = Move(Geometry=scale_2.Geometry, Motion=unit_z_7)  # -> Geometry, Transform
move_6 = Move(Geometry=move_5.Geometry, Motion=unit_x)  # -> Geometry, Transform
geometry = Geometry(move_6.Geometry)
geo_2 = Geometry(geometry)
cluster_10 = Cluster_3(geo=geo_2, D=cull_i_3, data=cluster_9.P)

custom_preview_6 = CustomPreview(Geometry=cluster_10, Shader=ColourSwatch(SwatchColor=RGBA(2, 41, 23, 17)))

geo_3 = Geometry(cluster_10)
bhomgeo = BHoMGeometry(geo_3)

# ==== cluster Cluster
garden_size = ClusterInput()
boundaries = ClusterInput()
line = ClusterInput()
maxamount = ClusterInput()
number_slider = Slider(7, range=0..10)
item = ListItem(List=garden_size, Index=0, Wrap=True)  # -> Item, Item1
geo = Geometry(flatten(boundaries))
cull_i = CullIndex(List=line, Indices=0, Wrap=True)
item_2 = ListItem(List=line, Index=0, Wrap=True)
rectangle = Rectangle(Plane=PlaneXY(0, 0, 0), XSize=item.Item, YSize=item.Item1, Radius=0)  # -> Rectangle, Length
len = Length(Curve=item_2)
num = Number(item.Item1)
data = Data(rectangle.Rectangle)
getplacement = CSharpScript(
    line=item_2,
    minAmount=Slider(3, range=0..10),
    maxAmount=maxamount,
    segmentLength=num,
    spaceDist=Slider(8000, range=0..10000))  # -> points, lineCombinations; inputs line: Line, minAmount: Double, maxAmount: Double, segmentLength: Double, spaceDist: Double
# ---------- getplacement: C# ----------
    //========================================================
    //Declaration - fixed values
    //========================================================
    double lineLength = line.Length;
    Point3d startPt = line.From;
    Vector3d vec = (line.Direction) / lineLength;
    Vector3d husVec = vec * segmentLength;
    Vector3d spaceVec = vec * (spaceDist + segmentLength);

    //========================================================
    //Declaration - lists and new objects
    //========================================================
    Line currLine = new Line();
    Point3d currPt = new Point3d();
    List<Point3d> pointPos = new List<Point3d>();
    List<Line> lineCombination = new List<Line>();

    currPt = startPt;
    double currLength = segmentLength;
    int i = 0;
    while (currLength < lineLength)
    {
      currLine = new Line(currPt, husVec);
      currPt = currLine.To;
      pointPos.Add(currPt);
      lineCombination.Add(currLine);
      currLength = currLength + segmentLength;
      i = i + 1;

      //if i = max amunt: add spaceDist and reset counter.
      // Todo: add a new branch
      if (i == maxAmount)
      {
        currLine = new Line(currPt, spaceVec);
        currPt = currLine.To;
        currLength = currLength + spaceDist + segmentLength;
        i = 0;
      }
    }

    //========================================================
    // Remove lines that are too short. minAmount * segmentLength
    //========================================================
    if (i < minAmount)
    {
      lineCombination.RemoveRange(lineCombination.Count - i, i);
    }

    points = pointPos;
    lineCombinations = lineCombination;
# ---------- end getplacement ----------
panel = Panel(len)
vec = Vector(item_2)
getrotangle = GetRotAngle(vec=vec)
placegarden = PlaceGarden(G=data, A=getrotangle, pt=getplacement.points)  # -> G_2, X
boundary = Geometry(geo)
checkintersecs = CheckIntersecs(geo=boundary, data=placegarden.G_2)
cull_cutted = CullCutted(G_2=data, G=checkintersecs)
geo_2 = Geometry(geo)
data_2 = Data(data)
trimregions = TrimRegions(geo=geo_2, C=checkintersecs)
cull = CullPattern(List=checkintersecs, CullPattern=cull_cutted)
area = Area(Geometry=cull)  # -> Area, Centroid
data_3 = Data(getrotangle)
deg = Degrees(Radians=data_3)
lng = ListLength(List=area.Centroid)
rotangles = ClusterInput()
gardens = ClusterInput()
midpts = ClusterInput()
repeat = RepeatData(Data=deg, Length=lng)  # -> flatten(Data)
data_4 = Data(flatten(area.Centroid))
data_5 = Data(gardens)
data_6 = Data(rotangles)
data_7 = Data(midpts)
lng_2 = ListLength(List=data_7)
lng_3 = ListLength(List=data_6)
lng_4 = ListLength(List=data_5)
ins = InsertItems(List=data_5, Item=flatten(cull), Indices=lng_4, Wrap=False)
ins_2 = InsertItems(List=data_6, Item=repeat, Indices=lng_3, Wrap=False)
ins_3 = InsertItems(List=data_7, Item=data_4, Indices=lng_2, Wrap=False)
data_8 = Data(cull_i)
newregions = ClusterOutput(trimregions)
newlines = ClusterOutput(data_8)
rotangles_2 = ClusterOutput(ins_2)
midpts_2 = ClusterOutput(ins_3)
houses = ClusterOutput(ins)

# ==== cluster Lines
C = ClusterInput()
x = ClusterInput()
explode = Explode(Curve=C, Recursive=True)  # -> Segments, Vertices
A = ClusterInput()
L = ClusterInput()
neg = Negative(Value=x)
ext = ExtendCurve(Curve=explode.Segments, Type=0, Start=neg, End=neg)
item = ListItem(List=L, Index=1, Wrap=True)
jitter = Jitter(List=ext, Jitter=1, Seed=2)  # -> simplify(Values), Indices
multiplication = Multiplication(A=A, B=item)
len = Length(Curve=jitter.Values)
smaller = SmallerThan(FirstNumber=multiplication, SecondNumber=len)  # -> SmallerThan, OrEqualTo
cull = CullPattern(List=jitter.Values, CullPattern=smaller.SmallerThan)
L_2 = ClusterOutput(cull)

# ==== cluster CreateBoundary
M = ClusterInput()
medges = MeshEdges(Mesh=M)  # -> NakedEdges, InteriorEdges, NonManifoldEdges
geo = Geometry(medges.NakedEdges)
join = JoinCurves(Curves=medges.NakedEdges, Preserve=False)  # -> flatten(Curves)
project = Project(Geometry=join, Plane=PlaneXY(0, 0, 0))  # -> Geometry, Transform
simplify = SimplifyCurve(Curve=project.Geometry)  # -> Curve, Simplified
flip = FlipCurve(Curve=simplify.Curve, Guide=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)  # -> Curve, Flag
data = Data(flip.Curve)
data_2 = ClusterOutput(data)

# ==== cluster Cluster_2
data = ClusterInput()
data_2 = ClusterInput()
geo = ClusterInput()
data_3 = Data(data)
data_4 = Data(data_2)
geo_2 = Geometry(geo)
mjoin = MeshJoin(Meshes=flatten(geo_2))
area = Area(Geometry=data_4)  # -> Area, Centroid
project = ProjectPoint(Point=area.Centroid, Direction=Vector(0, 0, 1), Geometry=mjoin)  # -> Point, Index
clean = CleanTree(RemoveNulls=True, RemoveInvalid=True, RemoveEmpty=False, Tree=area.Centroid)  # -> flatten(Tree)
clean_2 = CleanTree(RemoveNulls=True, RemoveInvalid=True, RemoveEmpty=False, Tree=project.Point)  # -> flatten(Tree)
pt = Point(project.Point)
flatten = FlattenTree(Tree=clean_2, Path="{0}")
cullpt = CullDuplicates(Points=flatten(pt), Tolerance=expr("0.01", 0.1), CullMode=3)  # -> Points, Indices, Valence
vec2pt = Vector2Pt(PointA=clean, PointB=flatten, Unitize=False)  # -> Vector, Length
P = ClusterOutput(cullpt.Points)
move = Move(Geometry=data_4, Motion=vec2pt.Vector)  # -> Geometry, Transform
Z = UnitZ(Factor=data_3)
extr = Extrude(Base=move.Geometry, Direction=Z)
capex = CapHolesEx(Brep=extr)  # -> Brep, Caps, Solid
B = ClusterOutput(capex.Brep)

# ==== cluster Cluster_3
geo = ClusterInput()
geo_2 = Geometry(geo)
bbox = BoundingBox(Content=geo_2, Plane=PlaneXY(0, 0, 0))  # -> Box, Box_2
box = EvaluateBox(Box=bbox.Box, UParameter=0.5, VParameter=0.5, WParameter=0.5)  # -> Plane, Point, Include
data = ClusterInput()
project = Project(Geometry=box.Point, Plane=PlaneXY(0, 0, 0))  # -> Geometry, Transform
pt = Point(project.Geometry)
data_2 = Data(data)
vec2pt = Vector2Pt(PointA=pt, PointB=data_2, Unitize=False)  # -> Vector, Length
move = Move(Geometry=geo_2, Motion=vec2pt.Vector)  # -> Geometry, Transform
D = ClusterInput()
xy = XYPlane(Origin=data_2)
rad = Radians(Degrees=D)
rotate = Rotate(Geometry=move.Geometry, Angle=rad, Plane=xy)  # -> Geometry, Transform
G = ClusterOutput(rotate.Geometry)

# ==== cluster Cluster_4
geo = ClusterInput()
geo_2 = ClusterInput()
geo_3 = Geometry(geo)
geo_4 = Geometry(geo_2)
offset = OffsetCurve(Curve=geo_4, Distance=expr("-5000", 1), Plane=PlaneXY(0, 0, 0), Corners=1)
area = Area(Geometry=offset)  # -> expr("x/1000000000", Area), Centroid
round = Round(Number=area.Area)  # -> Nearest, Floor, Ceiling
pop2d = Populate2D(Region=offset, Count=round.Ceiling, Seed=1)
project = ProjectPoint(Point=pop2d, Direction=unitize(Vector(0, 0, 1)), Geometry=geo_3)  # -> Point, Index
P = ClusterOutput(project.Point)

# ==== cluster SeedNsimplify
geo = ClusterInput()
geo_2 = Geometry(geo)
explode = Explode(Curve=geo_2, Recursive=True)  # -> Segments, simplify(Vertices)
end = EndPoints(Curve=explode.Segments)  # -> Start, End
shift = ShiftList(List=explode.Segments, Shift=1, Wrap=True)
dprod = DotProduct(VectorA=unitize(explode.Segments), VectorB=unitize(shift), Unitize=False)  # -> simplify(DotProduct)
smaller = SmallerThan(FirstNumber=dprod, SecondNumber=Slider(0.872, range=0..1))  # -> SmallerThan, OrEqualTo
geo_3 = Geometry(graft(geo_2))
cull = CullPattern(List=end.End, CullPattern=smaller.SmallerThan)
crv_cp = CurveClosestPoint(Point=simplify(cull), Curve=reparameterize(geo_3))  # -> Point, simplify(Parameter), Distance
z = ClusterInput()
python = GhPythonScript(x=crv_cp.Parameter, y=Slider(0.93, range=0..10), z=z)  # -> out, a; inputs x: list
# ---------- python: Python ----------
__author__ = "Erik"
__version__ = "2019.03.06"

import rhinoscriptsyntax as rs
import ghpythonlib.components as gh
import random

t = x
fac = y
t.append(float(0))
t.append(float(1))
newT = gh.SortList(t,t)[1]
t = gh.SortList(t,t)[1]
b = t
for i in range(0, len(t)-1):
    thisT = t[i]
    nextT = t[i+1]
    diff = nextT-thisT
    if diff > 1/6:
        newT.append(thisT+diff/2)
t2 = gh.SortList(newT,newT)[1]
for i in range(0, len(t2)-1):
    thisT = t2[i]
    nextT = t2[i+1]
    diff = nextT-thisT
    if random.uniform(0,1)/fac < diff:
        newPt = random.normalvariate(1,0.1)*diff/2
        newT.append(thisT+newPt)
a = gh.SortList(newT,newT)[1]
# ---------- end python ----------
cull_i = CullIndex(List=python.a, Indices=0, Wrap=True)
eval = EvaluateCurve(Curve=reparameterize(geo_3), Parameter=cull_i)  # -> Point, Tangent, Angle
pline = PolyLine(Vertices=eval.Point, Closed=True)
pl = ClusterOutput(pline)

# ==== cluster GetRotAngle
vec = ClusterInput()
vec_2 = Vector(vec)
devec = DeconstructVector(Vector=vec_2)  # -> flatten(XComponent), YComponent, ZComponent
larger = LargerThan(FirstNumber=devec.XComponent, SecondNumber=0)  # -> LargerThan, OrEqualTo
angle = Angle(VectorA=Vector(0, 1, 0), VectorB=vec_2)  # -> flatten(Angle), flatten(Reflex)
p_n_c = PickNChoose(Pattern=larger.LargerThan, Stream0=angle.Angle, Stream1=angle.Reflex)  # -> graft(Result)
num = Number(p_n_c)
match = MatchTree(Tree=num, Guide=vec_2)
angle_2 = ClusterOutput(match)

# ==== cluster PlaceGarden
G = ClusterInput()
A = ClusterInput()
pt = ClusterInput()
pt_2 = Point(pt)
origin = Point(Point(0, 0, 0))
vec2pt = Vector2Pt(PointA=origin, PointB=pt_2, Unitize=False)  # -> Vector, Length
move = Move(Geometry=G, Motion=vec2pt.Vector)  # -> Geometry, Transform
xy = XYPlane(Origin=pt_2)
transform = Transform(flatten(move.Transform))
rotate = Rotate(Geometry=simplify(move.Geometry), Angle=expr("x+pi", simplify(graft(A))), Plane=simplify(xy))  # -> Geometry, Transform
transform_2 = Transform(flatten(rotate.Transform))
transform_3 = Transform(graft(transform_2))
transform_4 = Transform(graft(transform))
comp = Compound(Transforms=[transform_4, transform_3])  # -> flatten(Compound)
G_2 = ClusterOutput(rotate.Geometry)
X = ClusterOutput(comp)

# ==== cluster CheckIntersecs
data = ClusterInput()
geo = ClusterInput()
data_2 = Data(simplify(data))
geo_2 = Geometry(geo)
match = MatchTree(Tree=graft(geo_2), Guide=data_2)
rint = RegionIntersection(CurvesA=data_2, CurvesB=match, Plane=PlaneXY(0, 0, 0))  # -> simplify(Result)
len = Length(Curve=rint)
larger = LargerThan(FirstNumber=len, SecondNumber=Slider(1000, range=0..1000))  # -> LargerThan, OrEqualTo
cull = CullPattern(List=rint, CullPattern=larger.LargerThan)
data_3 = Data(cull)
data_4 = ClusterOutput(data_3)

# ==== cluster CullCutted
G = ClusterInput()
G_2 = ClusterInput()
area = Area(Geometry=G)  # -> Area, Centroid
area_2 = Area(Geometry=G_2)  # -> Area, Centroid
subtraction = Subtraction(A=area_2.Area, B=area.Area)
abs = Absolute(Value=subtraction)
smaller = SmallerThan(FirstNumber=abs, SecondNumber=1)  # -> SmallerThan, OrEqualTo
data = Data(smaller.OrEqualTo)
data_2 = ClusterOutput(data)

# ==== cluster TrimRegions
C = ClusterInput()
data = Data(C)
divide = DivideCurve(Curve=C, Count=2, Kinks=True)  # -> simplify(Points), Tangents, Parameters
path_mapper = PathMapper(divide.Points, source="{A;B}", target="{A}")
geo = ClusterInput()
cullpt = CullDuplicates(Points=path_mapper, Tolerance=0.001, CullMode=3)  # -> Points, Indices, Valence
hull = ConvexHull(Points=cullpt.Points, Plane=PlaneXY(0, 0, 0))  # -> Hull, HullZ, Indices
geo_2 = Geometry(graft(geo))
offset = OffsetCurve(Curve=hull.Hull, Distance=Slider(100, range=0..100), Plane=PlaneXY(0, 0, 0), Corners=1)
match = MatchTree(Tree=geo_2, Guide=offset)
xy = XYPlane(Origin=Point(0, 0, 0))
rdiff = RegionDifference(CurvesA=match, CurvesB=offset, Plane=xy)  # -> simplify(Result)
area = Area(Geometry=rdiff)  # -> Area, Centroid
sort = SortList(Keys=area.Area, ValuesA=rdiff)  # -> Keys, ValuesA
item = ListItem(List=sort.ValuesA, Index=-1, Wrap=True)
i = ClusterOutput(item)
