# Grasshopper definition HousePacking.gh (Grasshopper 1.0.7)
# plug-ins: Kangaroo Components, PlotPlanning

# ----
# Variation as a parameter to evaluate?
# House types, length spread, orientations
# 
# Ensure the vectors always point towards centre
# 
# How to flip house rows?
# 
# vad ska komma först - husen eller övriga areor (green area, parking etc)?
# Ska vi implementera forst fit på övriga areor om husen placeras först?
# 1. Create Set
# A
# B
# C
panel = Panel("""18
7""")
panel_2 = Panel("""16
9""")
panel_3 = Panel("""14
10""")
item = ListItem(List=panel, Index=0, Wrap=True)  # -> Item, Item1
item_2 = ListItem(List=panel_2, Index=0, Wrap=True)  # -> Item, Item1
item_3 = ListItem(List=panel_3, Index=0, Wrap=True)  # -> Item, Item1
rectangle = Rectangle(Plane=PlaneXY(0, 0, 0), XSize=item.Item, YSize=item.Item1, Radius=0)  # -> Rectangle, Length
rectangle_2 = Rectangle(Plane=PlaneXY(0, 0, 0), XSize=item_2.Item, YSize=item_2.Item1, Radius=0)  # -> Rectangle, Length
rectangle_3 = Rectangle(Plane=PlaneXY(0, 0, 0), XSize=item_3.Item, YSize=item_3.Item1, Radius=0)  # -> Rectangle, Length
merge = Merge(Data1=rectangle.Rectangle, Data2=rectangle_2.Rectangle, Data3=rectangle_3.Rectangle)

# ----
# 2. Select houses
# 3. Define site boundaries
number_slider = Slider(3, range=0..3)
filter = StreamFilter(
    Gate=number_slider,
    Stream0=rectangle.Rectangle,
    Stream1=rectangle_2.Rectangle,
    Stream2=rectangle_3.Rectangle,
    Stream3=merge)

geo = Geometry(Tree({0}: [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], {1}: [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], {2}: [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], {3}: [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], {4}: [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]))
geo_2 = Geometry(<brep referenced from the Rhino model>)
preview = CustomPreview(Geometry=geo_2, Material=ColourSwatch(SwatchColor=RGBA(171, 171, 171, 181)))

lng = ListLength(List=merge)
dom = ConstructDomain(DomainStart=0, DomainEnd=lng)
random = Random(Range=dom, Number=1, Seed=Slider(1, range=0..10))
round = Round(Number=random)  # -> Nearest, Floor, Ceiling
rectangle_4 = Geometry(filter)
item_4 = ListItem(List=rectangle_4, Index=round.Nearest, Wrap=True)

item_5 = ListItem(List=rectangle_4, Index=Slider(2, range=0..10), Wrap=True)
item_6 = ListItem(List=rectangle_4, Index=Slider(3, range=0..10), Wrap=True)

minamount = Slider(2, range=0..10)
maxamount = Slider(4, range=0..10)
spacedistance = Slider(0, range=0..10)
seed = Slider(6, range=0..10)
geo_3 = Geometry([<curve referenced from the Rhino model> x6])

Z = UnitZ(Factor=1)
geo_4 = Geometry([<curve referenced from the Rhino model> x6])
counter = Counter(Reset=True)
project = Project(Curve=geo_4, Brep=geo_2, Direction=Z)
multiplication = Multiplication(A=counter, B=Slider(0.01, range=0..0.01))
round_2 = Round(Number=multiplication)  # -> Nearest, Floor, Ceiling
dam = DataDam(BufferDelay=10000000, BufferMode=0)
Z_2 = UnitZ(Factor=1)
Z_3 = UnitZ(Factor=1)
Z_4 = UnitZ(Factor=1)

cluster = Cluster(bounds=geo_3, rectangle=item_5, minamount=minamount, maxamount=maxamount, seed=seed, spacedist=spacedistance)  # -> pl, region, C, simplify(tanvec)
cluster_2 = Cluster(bounds=cluster.pl, rectangle=item_4, minamount=minamount, maxamount=maxamount, seed=seed, spacedist=spacedistance)  # -> pl, region, C, simplify(tanvec)
cluster_3 = Cluster(bounds=cluster_2.pl, rectangle=item_6, minamount=minamount, maxamount=maxamount, seed=seed, spacedist=spacedistance)  # -> pl, region, C, simplify(tanvec)

cluster_4 = Cluster(bounds=cluster_3.pl, rectangle=item_6, minamount=minamount, maxamount=maxamount, seed=seed, spacedist=spacedistance)  # -> pl, region, C, simplify(tanvec)
cluster_5 = Cluster(bounds=cluster_3.pl, rectangle=item_6, minamount=minamount, maxamount=maxamount, seed=seed, spacedist=spacedistance)  # -> pl, region, C, simplify(tanvec)
cluster_6 = Cluster(bounds=cluster_5.pl, rectangle=item_6, minamount=minamount, maxamount=maxamount, seed=seed, spacedist=spacedistance)  # -> pl, region, C, simplify(tanvec)
cluster_7 = Cluster(bounds=cluster_6.pl, rectangle=item_6, minamount=minamount, maxamount=maxamount, seed=seed, spacedist=spacedistance)  # -> pl, region, C, simplify(tanvec)
geo_5 = Geometry([cluster_5.C, cluster_3.C, cluster_2.C, cluster.C, cluster_6.C])
cluster_8 = Cluster(bounds=cluster_7.pl, rectangle=item_6, minamount=minamount, maxamount=maxamount, seed=seed, spacedist=spacedistance)  # -> pl, region, C, simplify(tanvec)

entwine = Entwine(
    Branch0X=cluster.tanvec,
    Branch1X=cluster_2.tanvec,
    Branch2X=cluster_3.tanvec,
    Branch3X=cluster_5.tanvec,
    Branch4X=cluster_6.tanvec,
    Branch5X=cluster_7.tanvec,
    Branch6X=cluster_8.tanvec,
    FlattenInputs=False)  # -> simplify(Result)
entwine_2 = Entwine(
    Branch0X=cluster.region,
    Branch1X=cluster_2.region,
    Branch2X=cluster_3.region,
    Branch3X=cluster_5.region,
    Branch4X=cluster_6.region,
    Branch5X=cluster_7.region,
    Branch6X=cluster_8.region,
    FlattenInputs=False)

boundary = BoundarySurfaces(Edges=geo_5)

# ----
# OUTPUTS
housefootprint = Geometry(simplify(entwine_2))
newboundary = Geometry(cluster_8.C)

clean = CleanTree(RemoveNulls=True, RemoveInvalid=True, RemoveEmpty=Toggle(True), Tree=housefootprint)  # -> simplify(Tree)
disc = Discontinuity(Curve=clean, Level=1)  # -> simplify(Points), Parameters
path_mapper = PathMapper(disc.Points, source="{A;B;C}", target="{A;B}")
sort_pt = SortPoints(Points=path_mapper)  # -> Points, Indices
chull = ConvexHull(Pt=sort_pt.Points)  # -> flatten(AllLines)

# ----
# Green Areas
number_slider_2 = Slider(3, range=0..10)
offset = OffsetCurve(Curve=newboundary, Distance=number_slider_2, Plane=PlaneXY(0, 0, 0), Corners=1)
smoothpline = SmoothPolyline(Polyline=offset, Strength=Slider(0.8, range=0..1), Times=1)
boundary_2 = BoundarySurfaces(Edges=smoothpline)
preview_2 = CustomPreview(Geometry=boundary_2, Material=ColourSwatch(SwatchColor=RGB(31, 130, 38)))

project_2 = Project(Curve=smoothpline, Brep=geo_2, Direction=Vector(0, 0, 1))
srfsplit = SurfaceSplit(Surface=geo_2, Curves=flatten(project_2))
area = Area(Geometry=srfsplit)  # -> Area, Centroid
smaller = SmallerThan(FirstNumber=area.Area, SecondNumber="2000")  # -> SmallerThan, OrEqualTo
cull = CullPattern(List=srfsplit, CullPattern=smaller.SmallerThan)
move = Move(Geometry=cull, Motion=Z_4)  # -> Geometry, Transform
# Cull small areas
# Create new boundaries
preview_3 = CustomPreview(Geometry=move.Geometry, Material=ColourSwatch(SwatchColor=RGB(61, 92, 18)))

unit_z = UnitZ(Factor=1)
area_2 = Area(Geometry=housefootprint)  # -> Area, Centroid
panel_4 = Panel("""-0.450
-0.250
0
0.250
0.450""")

clean_2 = CleanTree(RemoveNulls=True, RemoveInvalid=True, RemoveEmpty=Toggle(False), Tree=area_2.Centroid)

project_point = ProjectPoint(Point=clean_2, Direction=unit_z, Geometry=geo_2)  # -> Point, Index
list_item = ListItem(List=project_point.Point, Index=0, Wrap=True)
xy_plane = XYPlane(Origin=list_item)
project_3 = Project(Geometry=project_point.Point, Plane=xy_plane)  # -> simplify(Geometry), Transform

snaptotopo = SnapToTopo(TopoPts=project_3.Geometry, PlanePts=project_point.Point, PossibleValues=panel_4)
vec2pt = Vector2Pt(PointA=clean_2, PointB=snaptotopo, Unitize=False)  # -> Vector, Length

boundary_3 = BoundarySurfaces(Edges=simplify(housefootprint))
area_3 = Area(Geometry=boundary_3)  # -> Area, Centroid
Z_5 = UnitZ(Factor=Slider(5, range=0..10))
xy = XYPlane(Origin=area_3.Centroid)
extr = Extrude(Base=entwine_2, Direction=Z_5)
deplane = DeconstructPlane(Plane=xy)  # -> Origin, XAxis, YAxis, ZAxis
cap = CapHoles(Brep=extr)
rotate = RotateDirection(Geometry=xy, Center=area_3.Centroid, From=deplane.XAxis, To=entwine)  # -> Geometry, Transform
scale_nu = ScaleNU(Geometry=cap, Plane=rotate.Geometry, ScaleX=1, ScaleY=Slider(0.4, range=0..1), ScaleZ=Slider(0.6, range=0..1))  # -> Geometry, Transform

# ----
# Previews
number_slider_3 = Slider(5, range=0..10)
Z_6 = UnitZ(Factor=number_slider_3)
area_4 = Area(Geometry=merge)  # -> Area, Centroid
extr_2 = Extrude(Base=housefootprint, Direction=Z_6)
bnd = Bounds(Numbers=area_4.Area)
cap_2 = CapHoles(Brep=extr_2)
area_5 = Area(Geometry=housefootprint)  # -> Area, Centroid
dedomain = DeconstructDomain(Domain=bnd)  # -> Start, End
gradient = Gradient(
    LowerLimit=dedomain.Start,
    UpperLimit=dedomain.End,
    Parameter=area_5.Area,
    stops=[0.0592: RGB(111, 176, 150), 0.528: RGB(199, 195, 70), 0.934: RGB(176, 42, 109)])

preview_4 = CustomPreview(Geometry=scale_nu.Geometry, Material=gradient)

move_2 = Move(Geometry=cap_2, Motion=vec2pt.Vector)  # -> Geometry, Transform

preview_5 = CustomPreview(Geometry=move_2.Geometry, Material=gradient)

# ----
# Trees
mesh = Mesh(<mesh referenced from the Rhino model>)
area_6 = Area(Geometry=smoothpline)  # -> Area, Centroid
bbox = BoundingBox(Content=mesh, Plane=PlaneXY(0, 0, 0))  # -> Box, Box_2
division = Division(A=area_6.Area, B=area_6.Area)
project_4 = Project(Geometry=bbox.Box, Plane=PlaneXY(0, 0, 0))  # -> Geometry, Transform
area_7 = Area(Geometry=project_4.Geometry)  # -> Area, Centroid
pop2d = Populate2D(Region=smoothpline, Count=division, Seed=1)

project_5 = ProjectPoint(Point=area_7.Centroid, Direction=Z_2, Geometry=geo_2)  # -> Point, Index
project_6 = ProjectPoint(Point=pop2d, Direction=Z_3, Geometry=geo_2)  # -> Point, Index

vec2pt_2 = Vector2Pt(PointA=project_5.Point, PointB=project_6.Point, Unitize=False)  # -> Vector, Length
move_3 = Move(Geometry=mesh, Motion=vec2pt_2.Vector)  # -> Geometry, Transform
preview_6 = CustomPreview(Geometry=move_3.Geometry, Material=ColourSwatch(SwatchColor=RGB(39, 84, 8)))

# ==== cluster Cluster
rectangle = ClusterInput()
spacedist = ClusterInput()
bounds = ClusterInput()
maxamount = ClusterInput()
minamount = ClusterInput()
seed = ClusterInput()

# ----
# Access Points, Rotation angl, rectangles
bounds_2 = Geometry(bounds)
bounds_3 = SegmentBounds(Bounds=bounds_2, Rectangle=rectangle, Seed=seed)  # -> AllLines, CurrentLine
createaccesspoints = PlotPlanning(Line=bounds_3.CurrentLine, MinAmount=minamount, MaxAmount=maxamount, Rectangle=rectangle, SpcaceDist=spacedist)  # -> simplify(AccessPts), TanVect
createrectangles = HOuseFootprint(BaseRectangle=rectangle, Position=createaccesspoints.AccessPts, TanVector=createaccesspoints.TanVect)
cullsmallareas = CullSmallAreas(Rec=createrectangles, Bound=graft(bounds_2))  # -> simplify(Region)

geo = Geometry(bounds_3.CurrentLine)
generate2dlayout = Generate2DLyaout(
    BaseRectangle=rectangle,
    Position=createaccesspoints.AccessPts,
    TanVector=createaccesspoints.TanVect,
    Bound=graft(bounds_2))
cullsmallareas_2 = CullSmallAreas(Rec=createrectangles, Bound=graft(bounds_2))
path_mapper = PathMapper(cullsmallareas, source="{A;B}", target="{A}")

# ----
# Create new boundaries
c_script = CSharpScript(x=path_mapper)  # -> out, A; inputs x: list of Polyline
# ---------- c_script: C# ----------
    List <Point3d> ptList = new List <Point3d>();

    foreach (var pLine in x)
    {



      if (pLine != null)
      {
        foreach (var l in pLine.GetSegments())
        {
          ptList.Add(l.From);
          ptList.Add(l.To);
        }
      }
      A = Rhino.Geometry.Point3d.SortAndCullPointList(ptList, 0.01);
    }
# ---------- end c_script ----------
chull = ConvexHull(Pt=c_script.A)
clean = CleanTree(RemoveNulls=True, RemoveInvalid=True, RemoveEmpty=False, Tree=chull)
offset = OffsetCurve(Curve=clean, Distance=Slider(10, range=0..100), Plane=PlaneXY(0, 0, 0), Corners=1)
xy = XYPlane(Origin=Point(0, 0, 0))
rdiff = RegionDifference(CurvesA=graft(bounds_2), CurvesB=offset, Plane=xy)  # -> simplify(Result)

area = Area(Geometry=rdiff)  # -> Area, Centroid
bnd = Bounds(Numbers=area.Area)
dedomain = DeconstructDomain(Domain=bnd)  # -> Start, End
equals = Equality(FirstNumber=area.Area, SecondNumber=dedomain.End)  # -> Equality, Inequality
cull = CullPattern(List=rdiff, CullPattern=equals.Equality)
disc = Discontinuity(Curve=cull, Level=1)  # -> Points, Parameters
pline = PolyLine(Vertices=disc.Points, Closed=True)

tanvec = ClusterOutput(createaccesspoints.TanVect)
region = ClusterOutput(cullsmallareas)
C = ClusterOutput(offset)
pl = ClusterOutput(pline)
