# Grasshopper definition HousePacking_c#Test_risåker.gh (Grasshopper 1.0.7)
# plug-ins: Human, PlotPlanning

# ----
# Variation as a parameter to evaluate?
# House types, length spread, orientations
# 
# Ensure the vectors always point towards centre
# 
# How to flip house rows?
# 
# vad ska komma först - husen eller övriga areor (green area, parking etc)?
# Ska vi implementera forst fit på övriga areor om husen placeras först?
# 1. Create Set
# A
# B
# C
panel = Panel("""18
7""")
panel_2 = Panel("""16
9""")
panel_3 = Panel("""14
10""")
item = ListItem(List=panel, Index=0, Wrap=True)  # -> Item, Item1
item_2 = ListItem(List=panel_2, Index=0, Wrap=True)  # -> Item, Item1
item_3 = ListItem(List=panel_3, Index=0, Wrap=True)  # -> Item, Item1
rectangle = Rectangle(Plane=PlaneXY(0, 0, 0), XSize=item.Item, YSize=item.Item1, Radius=0)  # -> Rectangle, Length
rectangle_2 = Rectangle(Plane=PlaneXY(0, 0, 0), XSize=item_2.Item, YSize=item_2.Item1, Radius=0)  # -> Rectangle, Length
rectangle_3 = Rectangle(Plane=PlaneXY(0, 0, 0), XSize=item_3.Item, YSize=item_3.Item1, Radius=0)  # -> Rectangle, Length
merge = Merge(Data1=rectangle.Rectangle, Data2=rectangle_2.Rectangle, Data3=rectangle_3.Rectangle)

# ----
# 2. Select houses
# 3. Define site boundaries
number_slider = Slider(3, range=0..3)
filter = StreamFilter(
    Gate=number_slider,
    Stream0=rectangle.Rectangle,
    Stream1=rectangle_2.Rectangle,
    Stream2=rectangle_3.Rectangle,
    Stream3=merge)

geo = Geometry(Tree({0}: [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], {1}: [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], {2}: [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], {3}: [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], {4}: [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]))
geo_2 = Geometry(<brep referenced from the Rhino model>)
crv = Curve([<curve referenced from the Rhino model> x6])
preview = CustomPreview(Geometry=geo_2, Material=ColourSwatch(SwatchColor=RGBA(255, 255, 255, 181)))
simplify = SimplifyCurve(Curve=crv)  # -> Curve, Simplified
divide = DivideCurve(Curve=simplify.Curve, Count=Slider(39, range=0..100), Kinks=False)  # -> Points, Tangents, Parameters

lng = ListLength(List=merge)
dom = ConstructDomain(DomainStart=0, DomainEnd=lng)
random = Random(Range=dom, Number=1, Seed=Slider(1, range=0..10))
round = Round(Number=random)  # -> Nearest, Floor, Ceiling
rectangle_4 = Geometry(filter)
item_4 = ListItem(List=rectangle_4, Index=round.Nearest, Wrap=True)

pline = PolyLine(Vertices=divide.Points, Closed=False)
simplify_2 = SimplifyCurve(Curve=pline)  # -> Curve, Simplified
disc = Discontinuity(Curve=simplify_2.Curve, Level=1)  # -> Points, Parameters
pline_2 = PolyLine(Vertices=disc.Points, Closed=True)
item_5 = ListItem(List=rectangle_4, Index=Slider(2, range=0..10), Wrap=True)
project = Project(Geometry=pline_2, Plane=PlaneXY(0, 0, 0))  # -> Geometry, Transform
item_6 = ListItem(List=rectangle_4, Index=Slider(3, range=0..10), Wrap=True)

minamount = Slider(2, range=0..10)
maxamount = Slider(8, range=0..10)
spacedistance = Slider(8, range=0..10)
seed = Slider(6, range=0..10)
geo_3 = Geometry(flatten(project.Geometry))

Z = UnitZ(Factor=1)
geo_4 = Geometry([<curve referenced from the Rhino model> x6])
project_2 = Project(Curve=geo_4, Brep=geo_2, Direction=Z)  # disabled
mesh = Mesh([<mesh referenced from the Rhino model> x6])
mjoin = MeshJoin(Meshes=mesh)
Z_2 = UnitZ(Factor=1)
Z_3 = UnitZ(Factor=1)
Z_4 = UnitZ(Factor=Slider(0.2, range=0..1))

cluster = Cluster(bound=project.Geometry, baserec=item_5, minamount=minamount, maxamount=maxamount, spacedist=spacedistance, seed=seed)  # -> pl, region, C, simplify(tan); disabled
cluster_2 = Cluster(bound=cluster.pl, baserec=item_4, minamount=minamount, maxamount=maxamount, spacedist=spacedistance, seed=seed)  # -> pl, region, C, simplify(tan)
cluster_3 = Cluster(bound=cluster_2.pl, baserec=item_6, minamount=minamount, maxamount=maxamount, spacedist=spacedistance, seed=seed)  # -> pl, region, C, simplify(tan)

cluster_4 = Cluster(bound=cluster_3.pl, baserec=item_6, minamount=minamount, maxamount=maxamount, spacedist=spacedistance, seed=seed)  # -> pl, region, C, simplify(tan)
cluster_5 = Cluster(bound=cluster_3.pl, baserec=item_6, minamount=minamount, maxamount=maxamount, spacedist=spacedistance, seed=seed)  # -> pl, region, C, simplify(tan)
cluster_6 = Cluster(bound=cluster_5.pl, baserec=item_6, minamount=minamount, maxamount=maxamount, spacedist=spacedistance, seed=seed)  # -> pl, region, C, simplify(tan)
cluster_7 = Cluster(bound=cluster_6.pl, baserec=item_6, minamount=minamount, maxamount=maxamount, spacedist=spacedistance, seed=seed)  # -> pl, region, C, simplify(tan)
geo_5 = Geometry([cluster_5.C, cluster_3.C, cluster_2.C, cluster.C, cluster_6.C])
cluster_8 = Cluster(bound=cluster_7.pl, baserec=item_6, minamount=minamount, maxamount=maxamount, spacedist=spacedistance, seed=seed)  # -> pl, region, C, simplify(tan)

entwine = Entwine(
    Branch0X=cluster.tan,
    Branch1X=cluster_2.tan,
    Branch2X=cluster_3.tan,
    Branch3X=cluster_5.tan,
    Branch4X=cluster_6.tan,
    Branch5X=cluster_7.tan,
    Branch6X=cluster_8.tan,
    FlattenInputs=False)  # -> simplify(Result)
entwine_2 = Entwine(
    Branch0X=cluster.region,
    Branch1X=cluster_2.region,
    Branch2X=cluster_3.region,
    Branch3X=cluster_5.region,
    Branch4X=cluster_6.region,
    Branch5X=cluster_7.region,
    Branch6X=cluster_8.region,
    FlattenInputs=False)

boundary = BoundarySurfaces(Edges=geo_5)

# ----
# OUTPUTS
housefootprint = Geometry(simplify(entwine_2))
newboundary = Geometry(cluster_8.pl)

# ----
# Green Areas
number_slider_2 = Slider(3, range=0..10)
offset = OffsetCurve(Curve=newboundary, Distance=number_slider_2, Plane=PlaneXY(0, 0, 0), Corners=1)
smoothpline = SmoothPolyline(Polyline=offset, Strength=Slider(0.8, range=0..1), Times=1)
boundary_2 = BoundarySurfaces(Edges=smoothpline)
preview_2 = CustomPreview(Geometry=boundary_2, Material=ColourSwatch(SwatchColor=RGB(99, 130, 101)))

boundary_3 = BoundarySurfaces(Edges=simplify(housefootprint))
area = Area(Geometry=boundary_3)  # -> Area, Centroid
Z_5 = UnitZ(Factor=Slider(5, range=0..10))
xy = XYPlane(Origin=area.Centroid)
extr = Extrude(Base=entwine_2, Direction=Z_5)
deplane = DeconstructPlane(Plane=xy)  # -> Origin, XAxis, YAxis, ZAxis
cap = CapHoles(Brep=extr)
rotate = RotateDirection(Geometry=xy, Center=area.Centroid, From=deplane.XAxis, To=entwine)  # -> Geometry, Transform
scale_nu = ScaleNU(Geometry=cap, Plane=rotate.Geometry, ScaleX=1, ScaleY=Slider(0.5, range=0..1), ScaleZ=Slider(0.7, range=0..1))  # -> Geometry, Transform

project_3 = Project(Curve=housefootprint, Brep=geo_2, Direction=Vector(0, 0, 1))
previewlw = CustomPreviewLineweights(Geometry=project_3, Shader=ColourSwatch(SwatchColor=RGB(92, 92, 92)), Absolute=False)
project_4 = Project(Curve=smoothpline, Brep=geo_2, Direction=Vector(0, 0, 1))
srfsplit = SurfaceSplit(Surface=geo_2, Curves=flatten(project_4))
area_2 = Area(Geometry=srfsplit)  # -> Area, Centroid
smaller = SmallerThan(FirstNumber=area_2.Area, SecondNumber="2000")  # -> SmallerThan, OrEqualTo
cull = CullPattern(List=srfsplit, CullPattern=smaller.SmallerThan)
move = Move(Geometry=cull, Motion=Z_4)  # -> Geometry, Transform
# Cull small areas
# Create new boundaries
preview_3 = CustomPreview(Geometry=move.Geometry, Material=ColourSwatch(SwatchColor=RGB(134, 181, 67)))

unit_z = UnitZ(Factor=1)
area_3 = Area(Geometry=housefootprint)  # -> Area, Centroid
panel_4 = Panel("""-0.450
-0.250
0
0.250
0.450""")

clean = CleanTree(RemoveNulls=True, RemoveInvalid=True, RemoveEmpty=Toggle(False), Tree=area_3.Centroid)

project_point = ProjectPoint(Point=clean, Direction=unit_z, Geometry=geo_2)  # -> Point, Index
list_item = ListItem(List=project_point.Point, Index=0, Wrap=True)
xy_plane = XYPlane(Origin=list_item)
project_5 = Project(Geometry=project_point.Point, Plane=xy_plane)  # -> simplify(Geometry), Transform

snaptotopo = SnapToTopo(TopoPts=project_5.Geometry, PlanePts=project_point.Point, PossibleValues=panel_4)
vec2pt = Vector2Pt(PointA=clean, PointB=snaptotopo, Unitize=False)  # -> Vector, Length

# ----
# Previews
number_slider_3 = Slider(5, range=0..10)
Z_6 = UnitZ(Factor=number_slider_3)
area_4 = Area(Geometry=merge)  # -> Area, Centroid
extr_2 = Extrude(Base=housefootprint, Direction=Z_6)
bnd = Bounds(Numbers=area_4.Area)
cap_2 = CapHoles(Brep=extr_2)
area_5 = Area(Geometry=housefootprint)  # -> Area, Centroid
dedomain = DeconstructDomain(Domain=bnd)  # -> Start, End
gradient = Gradient(
    LowerLimit=dedomain.Start,
    UpperLimit=dedomain.End,
    Parameter=area_5.Area,
    stops=[0.0592: RGB(29, 74, 56), 0.442: RGB(101, 168, 129), 0.934: RGB(114, 138, 127)])
move_2 = Move(Geometry=scale_nu.Geometry, Motion=vec2pt.Vector)  # -> Geometry, Transform
preview_4 = CustomPreview(Geometry=move_2.Geometry, Material=gradient)

# ----
# Trees
mesh_2 = Mesh(mjoin)
area_6 = Area(Geometry=smoothpline)  # -> Area, Centroid
bbox = BoundingBox(Content=mesh_2, Plane=PlaneXY(0, 0, 0))  # -> Box, Box_2
division = Division(A=area_6.Area, B=area_6.Area)
project_6 = Project(Geometry=bbox.Box, Plane=PlaneXY(0, 0, 0))  # -> Geometry, Transform
area_7 = Area(Geometry=project_6.Geometry)  # -> Area, Centroid
pop2d = Populate2D(Region=smoothpline, Count=division, Seed=1)

project_7 = ProjectPoint(Point=area_7.Centroid, Direction=Z_2, Geometry=geo_2)  # -> Point, Index
project_8 = ProjectPoint(Point=pop2d, Direction=Z_3, Geometry=geo_2)  # -> Point, Index

vec2pt_2 = Vector2Pt(PointA=area_7.Centroid, PointB=project_8.Point, Unitize=False)  # -> Vector, Length
move_3 = Move(Geometry=mesh_2, Motion=vec2pt_2.Vector)  # -> Geometry, Transform
preview_5 = CustomPreview(Geometry=move_3.Geometry, Material=ColourSwatch(SwatchColor=RGB(70, 153, 15)))

# ==== cluster Cluster
maxamount = ClusterInput()
bound = ClusterInput()
minamount = ClusterInput()
spacedist = ClusterInput()
baserec = ClusterInput()
seed = ClusterInput()
generate2dlayout = Generate2DLyaout(BaseRectangle=baserec, Bound=bound, MinAmount=minamount, MaxAmount=maxamount, SpaceDist=spacedist, Seed=seed)  # -> Region, Tan

# ----
# Create new boundaries
c_script = CSharpScript(x=generate2dlayout.Region)  # -> out, A; inputs x: list of Polyline
# ---------- c_script: C# ----------
    List <Point3d> ptList = new List <Point3d>();

    foreach (var pLine in x)
    {



      if (pLine != null)
      {
        foreach (var l in pLine.GetSegments())
        {
          ptList.Add(l.From);
          ptList.Add(l.To);
        }
      }
      A = Rhino.Geometry.Point3d.SortAndCullPointList(ptList, 0.01);
    }
# ---------- end c_script ----------
chull = ConvexHull(Pt=c_script.A)  # -> simplify(AllLines)
offset = OffsetCurve(Curve=chull, Distance=Slider(5, range=0..100), Plane=PlaneXY(0, 0, 0), Corners=1)
rdiff = RegionDifference(CurvesA=simplify(graft(bound)), CurvesB=offset)  # -> simplify(Result)

area = Area(Geometry=rdiff)  # -> Area, Centroid
bnd = Bounds(Numbers=area.Area)
dedomain = DeconstructDomain(Domain=bnd)  # -> Start, End
equals = Equality(FirstNumber=area.Area, SecondNumber=dedomain.End)  # -> Equality, Inequality
cull = CullPattern(List=rdiff, CullPattern=equals.Equality)
disc = Discontinuity(Curve=cull, Level=1)  # -> Points, Parameters
pline = PolyLine(Vertices=disc.Points, Closed=True)

tan = ClusterOutput(generate2dlayout.Tan)
region = ClusterOutput(generate2dlayout.Region)
C = ClusterOutput(offset)
pl = ClusterOutput(pline)
