# Grasshopper definition StreetGeneration.gh (Grasshopper 1.0.7)
# plug-ins: Human, Kangaroo Components, Weaverbird, Kangaroo2 Components

geo = Geometry(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)  # disabled
crv = Curve(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)  # disabled
boundary = BoundarySurfaces(Edges=geo)  # disabled
pt = Point([<point referenced from the Rhino model> x2])  # disabled
pt_2 = Point([Point(119.2245313, 38.03178933, 0), Point(-46.88213903, -147.8341696, 0)])  # disabled

# ----
# User Inputs
streetboundaries_crv = Curve(geo)  # disabled
site_boundaries = Curve(<curve referenced from the Rhino model>)  # disabled
accesspoints = Point(pt)  # disabled
srf = Surface(boundary)  # disabled

selfintersect = BooleanToggle(False)  # disabled
mesh_shift = Slider(31, range=0..100)  # disabled
street_smoothness = Slider(5, range=0..10)  # disabled
mesh_size = Slider(17, range=0..100)  # disabled
button = Button()  # disabled
toggle = BooleanToggle(True)  # disabled
crv_cp = CurveClosestPoint(Point=accesspoints, Curve=streetboundaries_crv)  # -> Point, Parameter, Distance; disabled
rectangular_mesh_from_bounds = RectangularMeshFromBounds(P=crv_cp.Point, S=mesh_shift, reset=button, G=streetboundaries_crv, W=mesh_size, H=mesh_size, on=toggle, B=srf)  # disabled

# ---- group: Get lines
wbweave = WeaverbirdsMeshFromLinesWeaveBack(Lines=rectangular_mesh_from_bounds, MaximumValence=4)  # disabled
md = MeshDirection(Mesh=wbweave)  # disabled
warpweft = WarpWeft(Mesh=md)  # -> Warp, Weft, NakedA, NakedB; disabled
cull = CullPattern(List=warpweft.Weft, CullPattern=invert(warpweft.NakedB))  # disabled
cull_2 = CullPattern(List=warpweft.Warp, CullPattern=invert(warpweft.NakedA))  # disabled
join = JoinCurves(Curves=cull_2, Preserve=False)  # disabled
join_2 = JoinCurves(Curves=cull, Preserve=False)  # disabled
merge = Merge(Data1=join, Data2=join_2)  # -> flatten(Result); disabled

# ----
ln = Line(StartPoint=crv_cp.Point, EndPoint=accesspoints)  # disabled
wbmidedge = WeaverbirdsMidedgeSubdivision(MeshCurves=md, Level=1, SmoothNakedEdges=1)  # disabled

# ---- group: Find curves from access points
# PRIMARY STREETS
pull = PullPoint(Point=accesspoints, Geometry=merge, ClosestOnly=False)  # -> ClosestPoint, Distance; disabled
sort = SortList(Keys=pull.Distance, ValuesA=merge)  # -> Keys, ValuesA; disabled
item = ListItem(List=sort.ValuesA, Index=0, Wrap=True)  # disabled

# ----
number_slider = Slider(0.4, range=0..1)  # disabled
num = Number(number_slider)  # disabled
geo_2 = Geometry(merge)  # disabled
crv_2 = Curve(geo_2)  # disabled
cluster = Cluster()  # disabled
panel = Panel("""0
1""")  # disabled
number_slider_2 = Slider(0, range=0..100)  # disabled
panel_2 = Panel("-0.1")  # disabled
number_slider_3 = Slider(6, range=0..10)  # disabled
crv_3 = Curve(geo)  # disabled
number_slider_4 = Slider(6, range=0..10)  # disabled
number_slider_5 = Slider(2, range=0..10)  # disabled
number_slider_6 = Slider(20, range=0..30)  # disabled
crv_4 = Curve(<curve referenced from the Rhino model>)  # disabled
number_slider_7 = Slider(1, range=-1..1)  # disabled
toggle_2 = BooleanToggle(True)  # disabled
number_slider_8 = Slider(8, range=0..100)  # disabled
number_slider_9 = Slider(10, range=0..10)  # disabled
number_slider_10 = Slider(1, range=0..100)  # disabled
neg = Negative(Value=number_slider_6)  # disabled
offset = OffsetCurve(Curve=crv_4, Distance=neg, Plane=PlaneXY(0, 0, 0), Corners=number_slider_5)  # disabled
# Access vectors??
# We can have perpendicular lines and then join them to the grid
# Extend streets to closest point on curve
number_slider_11 = Slider(4, range=0..10)  # disabled
offset_2 = OffsetCurve(Curve=offset, Distance=number_slider_6, Plane=PlaneXY(0, 0, 0), Corners=1)  # disabled
number_slider_12 = Slider(1, range=0..10)  # disabled
item_2 = ListItem(Index=0, Wrap=True)  # disabled
panel_3 = Panel("1")  # disabled
number_slider_13 = Slider(0.001, range=0..0.001)  # disabled
number_slider_14 = Slider(0.12, range=0..10)  # disabled
number_slider_15 = Slider(1, range=0..1)  # disabled
number_slider_16 = Slider(0.1, range=0..0.1)  # disabled
geo_3 = Geometry(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)
crv_5 = Curve(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)
boundary_2 = BoundarySurfaces(Edges=geo_3)
pt_3 = Point([<point referenced from the Rhino model> x3])
pt_4 = Point([Point(119.2245313, 38.03178933, 0), Point(-46.88213903, -147.8341696, 0)])

# ----
# User Inputs
streetboundaries_crv_2 = Curve(geo_3)
site_boundaries_2 = Curve(<curve referenced from the Rhino model>)
accesspoints_2 = Point(pt_3)
srf_2 = Surface(boundary_2)

selfintersect_2 = BooleanToggle(False)
street_smoothness_2 = Slider(5, range=0..10)
mesh_shift_2 = Slider(31, range=0..100)
mesh_size_2 = Slider(17, range=0..100)
crv_cp_2 = CurveClosestPoint(Point=accesspoints_2, Curve=streetboundaries_crv_2)  # -> Point, Parameter, Distance
rectangular_mesh_from_bounds_2 = RectangularMeshFromBounds(
    P=crv_cp_2.Point,
    S=mesh_shift_2,
    reset=Button(),
    G=streetboundaries_crv_2,
    W=mesh_size_2,
    H=mesh_size_2,
    on=Toggle(True),
    B=srf_2)
line = Line(rectangular_mesh_from_bounds_2)
getgridfromlines = GetGridFromLines(line=rectangular_mesh_from_bounds_2)  # -> crv_2, crv_4
merge_2 = Merge(Data1=getgridfromlines.crv_2, Data2=getgridfromlines.crv_4)  # -> flatten(Result)
ln_2 = Line(StartPoint=crv_cp_2.Point, EndPoint=accesspoints_2)
crv_6 = Curve(merge_2)
# PRIMARY STREETS
pt_5 = Point(accesspoints_2)
pull_2 = PullPoint(Point=pt_5, Geometry=crv_6, ClosestOnly=False)  # -> ClosestPoint, Distance
sort_2 = SortList(Keys=pull_2.Distance, ValuesA=crv_6)  # -> Keys, ValuesA
item_3 = ListItem(List=sort_2.ValuesA, Index=0, Wrap=True)
end = EndPoints(Curve=item_3)  # -> Start, End
merge_3 = Merge(Data1=end.Start, Data2=end.End)
dist = Distance(PointA=graft(pt_5), PointB=merge_3)
flip = FlipCurve(Curve=item_3)  # -> Curve, Flag
python = GhPythonScript(x=dist)  # -> out, a; inputs x: list
# ---------- python: Python ----------
__author__ = "ErikF"
__version__ = "2019.06.13"

import rhinoscriptsyntax as rs

max = 0
a = 0
for i, val in enumerate(x): 
    if val > max:
        max = val
        a = i
# ---------- end python ----------
weave = Weave(Pattern=python.a, Stream0=flip.Curve, Stream1=item_3, NullGaps=False)
crv_7 = Curve(weave)
# Descide street lenght
num_2 = Number(Slider(0.6, range=-0.1..0.9))
eval = EvaluateLength(Curve=crv_7, Length=num_2, Normalized=True)  # -> simplify(Point), Tangent, Parameter
shatter = Shatter(Curve=crv_7, Parameters=eval.Parameter)
crv_cp_3 = CurveClosestPoint(Point=graft(crv_cp_2.Point), Curve=shatter)  # -> Point, Parameter, Distance
dist_2 = Distance(PointA=crv_cp_3.Point, PointB=graft(crv_cp_2.Point))
sort_3 = SortList(Keys=dist_2, ValuesA=shatter)  # -> Keys, ValuesA
item_4 = ListItem(List=sort_3.ValuesA, Index=0, Wrap=True)
# SECONDARY STREETS
crv_8 = Curve(flatten(item_4))
lng = ListLength(List=crv_8)
equals = Equality(FirstNumber=lng, SecondNumber=1)  # -> Equality, Inequality
p_n_c = PickNChoose(Pattern=equals.Equality, Stream0=graft(crv_8), Stream1="1")  # -> flatten(Result)
p_n_c_2 = PickNChoose(Pattern=equals.Equality, Stream0="1", Stream1=graft(crv_8))  # -> flatten(Result)
end_2 = EndPoints(Curve=p_n_c)  # -> Start, End
jitter = Jitter(List=end_2.End, Jitter=1, Seed=2)  # -> Values, Indices
item_5 = ListItem(List=jitter.Values, Index=0, Wrap=True)  # -> Item, Item1
item_6 = ListItem(List=p_n_c, Index=jitter.Indices, Wrap=True)
ln_3 = Line(StartPoint=item_5.Item, EndPoint=item_5.Item1)
join_3 = JoinCurves(Curves=[ln_2, item_4], Preserve=False)
join_4 = JoinCurves(Curves=[ln_3, item_6], Preserve=False)
smoothpline = SmoothPolyline(Polyline=join_4, Strength=1, Times=Slider(4, range=0..10))
flatten = FlattenTree(Tree=join_3, Path="{0}")
num_3 = Number(Slider(0.4, range=0..1))
geo_4 = Geometry(merge_2)
crv_9 = Curve(geo_4)  # disabled
cluster_2 = Cluster()
panel_4 = Panel("""0
1""")  # disabled
number_slider_17 = Slider(0, range=0..100)  # disabled
panel_5 = Panel("-0.1")  # disabled
number_slider_18 = Slider(6, range=0..10)  # disabled
crv_10 = Curve(geo_3)  # disabled
number_slider_19 = Slider(6, range=0..10)  # disabled
number_slider_20 = Slider(2, range=0..10)  # disabled
number_slider_21 = Slider(20, range=0..30)  # disabled
crv_11 = Curve(<curve referenced from the Rhino model>)  # disabled
number_slider_22 = Slider(1, range=-1..1)  # disabled
toggle_3 = BooleanToggle(True)  # disabled
number_slider_23 = Slider(8, range=0..100)  # disabled
number_slider_24 = Slider(10, range=0..10)  # disabled
number_slider_25 = Slider(1, range=0..100)  # disabled
neg_2 = Negative(Value=number_slider_21)  # disabled
offset_3 = OffsetCurve(Curve=crv_11, Distance=neg_2, Plane=PlaneXY(0, 0, 0), Corners=number_slider_20)  # disabled
# Access vectors??
# We can have perpendicular lines and then join them to the grid
# Extend streets to closest point on curve
number_slider_26 = Slider(4, range=0..10)  # disabled
offset_4 = OffsetCurve(Curve=offset_3, Distance=number_slider_21, Plane=PlaneXY(0, 0, 0), Corners=1)  # disabled
number_slider_27 = Slider(1, range=0..10)  # disabled
item_7 = ListItem(Index=0, Wrap=True)  # disabled
panel_6 = Panel("1")  # disabled
number_slider_28 = Slider(0.001, range=0..0.001)  # disabled
number_slider_29 = Slider(0.12, range=0..10)  # disabled
number_slider_30 = Slider(1, range=0..1)  # disabled
number_slider_31 = Slider(0.1, range=0..0.1)  # disabled

# ----
# Descide street lenght
number_slider_32 = Slider(0.5, range=-0.1..0.9)  # disabled

subtraction = Subtraction(A=1, B=number_slider_32)  # disabled

eval_2 = EvaluateLength(Curve=item, Length=graft([subtraction, number_slider_32]), Normalized=True)  # -> simplify(Point), Tangent, Parameter; disabled
shatter_2 = Shatter(Curve=item, Parameters=eval_2.Parameter)  # disabled
crv_cp_4 = CurveClosestPoint(Point=graft(crv_cp.Point), Curve=shatter_2)  # -> Point, Parameter, Distance; disabled
dist_3 = Distance(PointA=crv_cp_4.Point, PointB=graft(crv_cp.Point))  # disabled
sort_4 = SortList(Keys=dist_3, ValuesA=shatter_2)  # -> Keys, ValuesA; disabled
item_8 = ListItem(List=sort_4.ValuesA, Index=0, Wrap=True)  # disabled

join_5 = JoinCurves(Curves=[ln, item_8], Preserve=False)  # disabled
flatten_2 = FlattenTree(Tree=join_5, Path="{0}")  # disabled

# ----
# Join lines
pull_3 = PullPoint(Point=graft(eval_2.Point), Geometry=flatten(eval_2.Point), ClosestOnly=False)  # -> ClosestPoint, Distance; disabled
sort_5 = SortList(Keys=pull_3.Distance, ValuesA=flatten(eval_2.Point))  # -> Keys, ValuesA; disabled
panel_7 = Panel("1")  # disabled
item_9 = ListItem(List=sort_5.ValuesA, Index=panel_7, Wrap=True)  # disabled
ln_4 = Line(StartPoint=eval_2.Point, EndPoint=item_9)  # disabled

dupln = RemoveDuplicateLines(Lines=flatten(ln_4), Tolerance=0.01)  # disabled

clean = CleanTree(RemoveNulls=True, RemoveInvalid=True, RemoveEmpty=False, Tree=dupln)  # disabled
join_6 = JoinCurves(Curves=flatten([flatten_2, clean]), Preserve=False)  # disabled
smoothpline_2 = SmoothPolyline(Polyline=join_6, Strength=1, Times=street_smoothness)  # disabled

number_slider_33 = Slider(5, range=0..10)  # disabled
swatch = ColourSwatch(SwatchColor=RGB(18, 18, 18))  # disabled
# SECONDARY STREETS
project = Project(Curve=smoothpline_2, Brep=srf, Direction=Vector(0, 0, 1))  # disabled
previewlw = CustomPreviewLineweights(Geometry=project, Shader=swatch, Thickness=number_slider_33, Absolute=False)  # disabled

crv_12 = Curve(smoothpline_2)  # disabled
crv_13 = Curve(crv_12)  # disabled
len = Length(Curve=crv_13)  # disabled
crv_14 = Curve(crv_13)  # disabled
sort_6 = SortList(Keys=len, ValuesA=crv_13)  # -> Keys, ValuesA; disabled
item_10 = ListItem(List=sort_6.ValuesA, Index=0, Wrap=True)  # disabled
cull_i = CullIndex(List=sort_6.ValuesA, Indices=0, Wrap=True)  # disabled
len_2 = Length(Curve=item_10)  # disabled
multiplication = Multiplication(A=len_2, B=num)  # disabled
ext = ExtendCurve(Curve=reparameterize(item_10), Type=0, Start=expr("-x", multiplication), End=expr("-x", multiplication))  # disabled
ccx = CurveCurve(CurveA=ext, CurveB=crv_2)  # -> Points, ParamsA, ParamsB; disabled
lng_2 = ListLength(List=ccx.ParamsA)  # -> flatten(Length); disabled
equals_2 = Equality(FirstNumber=lng_2, SecondNumber=0)  # -> Equality, Inequality; disabled
cull_3 = CullPattern(List=crv_2, CullPattern=equals_2.Inequality)  # disabled
lng_3 = ListLength(List=cull_3)  # disabled
reduce = RandomReduce(List=cull_3, Reduction=expr("x-1", lng_3), Seed=1)  # disabled
ccx_2 = CurveCurve(CurveA=item_10, CurveB=reduce)  # -> Points, ParamsA, ParamsB; disabled
shatter_3 = Shatter(Curve=item_10, Parameters=ccx_2.ParamsA)  # disabled
shatter_4 = Shatter(Curve=reduce, Parameters=ccx_2.ParamsB)  # disabled
eval_3 = EvaluateCurve(Curve=reparameterize(shatter_4), Parameter=panel)  # -> Point, Tangent, Angle; disabled
crv_cp_5 = CurveClosestPoint(Point=graft(eval_3.Point), Curve=crv_14)  # -> Point, Parameter, simplify(Distance); disabled
crv_cp_6 = CurveClosestPoint(Point=eval_3.Point, Curve=item_10)  # -> Point, Parameter, Distance; disabled
sort_7 = SortList(Keys=crv_cp_5.Distance, ValuesA=crv_cp_5.Distance)  # -> Keys, ValuesA; disabled
item_11 = ListItem(List=sort_7.ValuesA, Index=0, Wrap=True)  # -> flatten(Item); disabled
sort_8 = SortList(Keys=item_11, ValuesA=shatter_4)  # -> Keys, ValuesA; disabled
item_12 = ListItem(List=sort_8.ValuesA, Index=-1, Wrap=True)  # disabled
ext_2 = ExtendCurve(Curve=reparameterize(item_12), Type=0, Start=number_slider_2, End=panel_2)  # disabled
merge_4 = Merge(Data1=shatter_3, Data2=item_12, Data3=cull_i)  # -> flatten(Result); disabled
getregions = GetRegions(crv_2=merge_4, crv=crv_3, num=number_slider_3)  # -> A, B; disabled
geo_5 = Geometry(getregions.B)  # disabled
geo_6 = Geometry(getregions.A)  # disabled
explode = Explode(Curve=geo_6, Recursive=True)  # -> simplify(Segments), Vertices; disabled
curvepoint = PointOnCurve(explode.Segments, parameter=0.5)  # disabled
seednsimplify = SeedNsimplify(geo=geo_5, z=number_slider_4)  # disabled
python_2 = GhPythonScript(x=geo_5)  # -> out, a, b; inputs x: Polyline; disabled; same code as python
explode_2 = Explode(Curve=geo_5, Recursive=True)  # -> simplify(Segments), simplify(Vertices); disabled
explode_3 = Explode(Curve=geo_5, Recursive=True)  # -> simplify(Segments), Vertices; disabled
curvepoint_2 = PointOnCurve(explode_3.Segments, parameter=0.5)  # disabled
branch = TreeBranch(Tree=explode_2.Vertices, Path="{0}", MaintainPaths=True)  # disabled
shift = ShiftList(List=explode_2.Vertices, Shift=number_slider_7, Wrap=toggle_2)  # disabled
shift_2 = ShiftList(List=explode_2.Segments, Shift=number_slider_7, Wrap=toggle_2)  # disabled
vec = Vector(explode_2.Segments)  # disabled
simplify = SimplifyCurve(Curve=getregions.B, Tolerance=number_slider_8, AngleTolerance=number_slider_10)  # -> Curve, Simplified; disabled
vec_2 = Vector(shift)  # disabled
vec_3 = Vector(shift_2)  # disabled
points = PointList(Points=branch, Size=number_slider_11)  # disabled
vec_4 = Vector(explode_2.Vertices)  # disabled
item_13 = ListItem(List=vec_3, Index=number_slider_12, Wrap=True)  # disabled
item_14 = ListItem(List=vec_2, Index=number_slider_12, Wrap=True)  # disabled
explode_4 = Explode(Curve=simplify.Curve, Recursive=True)  # -> simplify(Segments), simplify(Vertices); disabled
item_15 = ListItem(List=vec, Index=number_slider_12, Wrap=True)  # disabled
item_16 = ListItem(List=vec_4, Index=number_slider_12, Wrap=True)  # disabled
vdis = VectorDisplay(Anchor=item_14, Vector=item_13)  # disabled
vdis_2 = VectorDisplay(Anchor=item_16, Vector=item_15)  # disabled
dprod = DotProduct(VectorA=vec, VectorB=vec_3, Unitize=True)  # disabled
len_3 = Length(Curve=explode_2.Segments)  # disabled
subtraction_2 = Subtraction(A=panel_3, B=dprod)  # disabled
panel_8 = Panel(subtraction_2)  # disabled
multiplication_2 = Multiplication(A=len_3, B=subtraction_2)  # disabled
sort_9 = SortList(Keys=multiplication_2, ValuesA=multiplication_2)  # -> Keys, ValuesA; disabled
python_3 = GhPythonScript(x=subtraction_2, treshold=number_slider_13)  # -> out, a; inputs x: list; disabled
# ---------- python_3: Python ----------
__author__ = "ErikF"
__version__ = "2019.06.13"

import rhinoscriptsyntax as rs


indList = []

accum_sum = 0
for i,val in enumerate(x): 
    if accum_sum < treshold:
        accum_sum = accum_sum + val
    else:
        indList.append(i-1)
        accum_sum = 0
a = indList
# ---------- end python_3 ----------
item_17 = ListItem(List=sort_9.ValuesA, Index=-1, Wrap=True)  # disabled
division = Division(A=multiplication_2, B=item_17)  # disabled
panel_9 = Panel(multiplication_2)  # disabled
item_18 = ListItem(List=explode_2.Vertices, Index=python_3.a, Wrap=True)  # disabled
panel_10 = Panel(python_3.a)  # disabled

# ----
# Join lines
pull_4 = PullPoint(Point=graft(eval.Point), Geometry=flatten(eval.Point), ClosestOnly=False)  # -> ClosestPoint, Distance
sort_10 = SortList(Keys=pull_4.Distance, ValuesA=flatten(eval.Point))  # -> Keys, ValuesA
item_19 = ListItem(List=sort_10.ValuesA, Index="1", Wrap=True)
ln_5 = Line(StartPoint=eval.Point, EndPoint=item_19)

dupln_2 = RemoveDuplicateLines(Lines=flatten(ln_5), Tolerance=0.01)

clean_2 = CleanTree(RemoveNulls=True, RemoveInvalid=True, RemoveEmpty=False, Tree=dupln_2)
join_7 = JoinCurves(Curves=flatten([flatten, clean_2]), Preserve=False)
smoothpline_3 = SmoothPolyline(Polyline=join_7, Strength=1, Times=street_smoothness_2)

crv_15 = Curve(smoothpline_3)
crv_16 = Curve(crv_15)  # disabled
len_4 = Length(Curve=crv_16)  # disabled
crv_17 = Curve(crv_16)  # disabled
sort_11 = SortList(Keys=len_4, ValuesA=crv_16)  # -> Keys, ValuesA; disabled
item_20 = ListItem(List=sort_11.ValuesA, Index=0, Wrap=True)  # disabled
cull_i_2 = CullIndex(List=sort_11.ValuesA, Indices=0, Wrap=True)  # disabled
len_5 = Length(Curve=item_20)  # disabled
multiplication_3 = Multiplication(A=len_5, B=num_3)  # disabled
ext_3 = ExtendCurve(Curve=reparameterize(item_20), Type=0, Start=expr("-x", multiplication_3), End=expr("-x", multiplication_3))  # disabled
ccx_3 = CurveCurve(CurveA=ext_3, CurveB=crv_9)  # -> Points, ParamsA, ParamsB; disabled
lng_4 = ListLength(List=ccx_3.ParamsA)  # -> flatten(Length); disabled
equals_3 = Equality(FirstNumber=lng_4, SecondNumber=0)  # -> Equality, Inequality; disabled
cull_4 = CullPattern(List=crv_9, CullPattern=equals_3.Inequality)  # disabled
lng_5 = ListLength(List=cull_4)  # disabled
reduce_2 = RandomReduce(List=cull_4, Reduction=expr("x-1", lng_5), Seed=1)  # disabled
ccx_4 = CurveCurve(CurveA=item_20, CurveB=reduce_2)  # -> Points, ParamsA, ParamsB; disabled
shatter_5 = Shatter(Curve=item_20, Parameters=ccx_4.ParamsA)  # disabled
shatter_6 = Shatter(Curve=reduce_2, Parameters=ccx_4.ParamsB)  # disabled
eval_4 = EvaluateCurve(Curve=reparameterize(shatter_6), Parameter=panel_4)  # -> Point, Tangent, Angle; disabled
crv_cp_7 = CurveClosestPoint(Point=graft(eval_4.Point), Curve=crv_17)  # -> Point, Parameter, simplify(Distance); disabled
crv_cp_8 = CurveClosestPoint(Point=eval_4.Point, Curve=item_20)  # -> Point, Parameter, Distance; disabled
sort_12 = SortList(Keys=crv_cp_7.Distance, ValuesA=crv_cp_7.Distance)  # -> Keys, ValuesA; disabled
item_21 = ListItem(List=sort_12.ValuesA, Index=0, Wrap=True)  # -> flatten(Item); disabled
sort_13 = SortList(Keys=item_21, ValuesA=shatter_6)  # -> Keys, ValuesA; disabled
item_22 = ListItem(List=sort_13.ValuesA, Index=-1, Wrap=True)  # disabled
ext_4 = ExtendCurve(Curve=reparameterize(item_22), Type=0, Start=number_slider_17, End=panel_5)  # disabled
merge_5 = Merge(Data1=shatter_5, Data2=item_22, Data3=cull_i_2)  # -> flatten(Result); disabled
getregions_2 = GetRegions(crv_2=merge_5, crv=crv_10, num=number_slider_18)  # -> A, B; disabled
geo_7 = Geometry(getregions_2.B)  # disabled
geo_8 = Geometry(getregions_2.A)  # disabled
explode_5 = Explode(Curve=geo_8, Recursive=True)  # -> simplify(Segments), Vertices; disabled
curvepoint_3 = PointOnCurve(explode_5.Segments, parameter=0.5)  # disabled
seednsimplify_2 = SeedNsimplify(geo=geo_7, z=number_slider_19)  # disabled
python_4 = GhPythonScript(x=geo_7)  # -> out, a, b; inputs x: Polyline; disabled; same code as python
explode_6 = Explode(Curve=geo_7, Recursive=True)  # -> simplify(Segments), simplify(Vertices); disabled
explode_7 = Explode(Curve=geo_7, Recursive=True)  # -> simplify(Segments), Vertices; disabled
curvepoint_4 = PointOnCurve(explode_7.Segments, parameter=0.5)  # disabled
branch_2 = TreeBranch(Tree=explode_6.Vertices, Path="{0}", MaintainPaths=True)  # disabled
shift_3 = ShiftList(List=explode_6.Vertices, Shift=number_slider_22, Wrap=toggle_3)  # disabled
shift_4 = ShiftList(List=explode_6.Segments, Shift=number_slider_22, Wrap=toggle_3)  # disabled
vec_5 = Vector(explode_6.Segments)  # disabled
simplify_2 = SimplifyCurve(Curve=getregions_2.B, Tolerance=number_slider_23, AngleTolerance=number_slider_25)  # -> Curve, Simplified; disabled
vec_6 = Vector(shift_3)  # disabled
vec_7 = Vector(shift_4)  # disabled
points_2 = PointList(Points=branch_2, Size=number_slider_26)  # disabled
vec_8 = Vector(explode_6.Vertices)  # disabled
item_23 = ListItem(List=vec_7, Index=number_slider_27, Wrap=True)  # disabled
item_24 = ListItem(List=vec_6, Index=number_slider_27, Wrap=True)  # disabled
explode_8 = Explode(Curve=simplify_2.Curve, Recursive=True)  # -> simplify(Segments), simplify(Vertices); disabled
item_25 = ListItem(List=vec_5, Index=number_slider_27, Wrap=True)  # disabled
item_26 = ListItem(List=vec_8, Index=number_slider_27, Wrap=True)  # disabled
vdis_3 = VectorDisplay(Anchor=item_24, Vector=item_23)  # disabled
vdis_4 = VectorDisplay(Anchor=item_26, Vector=item_25)  # disabled
dprod_2 = DotProduct(VectorA=vec_5, VectorB=vec_7, Unitize=True)  # disabled
len_6 = Length(Curve=explode_6.Segments)  # disabled
subtraction_3 = Subtraction(A=panel_6, B=dprod_2)  # disabled
panel_11 = Panel(subtraction_3)  # disabled
multiplication_4 = Multiplication(A=len_6, B=subtraction_3)  # disabled
sort_14 = SortList(Keys=multiplication_4, ValuesA=multiplication_4)  # -> Keys, ValuesA; disabled
python_5 = GhPythonScript(x=subtraction_3, treshold=number_slider_28)  # -> out, a; inputs x: list; disabled; same code as python_3
item_27 = ListItem(List=sort_14.ValuesA, Index=-1, Wrap=True)  # disabled
division_2 = Division(A=multiplication_4, B=item_27)  # disabled
panel_12 = Panel(multiplication_4)  # disabled
item_28 = ListItem(List=explode_6.Vertices, Index=python_5.a, Wrap=True)  # disabled
panel_13 = Panel(python_5.a)  # disabled

# ==== cluster RectangularMeshFromBounds
P = ClusterInput()
B = ClusterInput()
G = ClusterInput()
W = ClusterInput()
H = ClusterInput()

# ----
# Create Rectangular Mesh
project = Project(Geometry=G, Plane=PlaneXY(0, 0, 0))  # -> Geometry, Transform
project_2 = Project(Curve=project.Geometry, Brep=B, Direction=Vector(0, 0, 1))
bbox = BoundingBox(Content=project_2, Plane=PlaneXY(0, 0, 0))  # -> Box, Box_2
cls = Closed(Curve=project_2)  # -> Closed, Periodic
area = Area(Geometry=bbox.Box)  # -> Area, Centroid
xy = XYPlane(Origin=area.Centroid)
rectangle = Rectangle(Plane=xy, XSize="20", YSize="20", Radius=0)  # -> Rectangle, Length
mplane = MeshPlane(Boundary=rectangle.Rectangle, WidthCount=W, HeightCount=H)  # -> Mesh, Area

# ----
# Rectangular boundary points
nakededge = MeshNakedEdge(Mesh=mplane.Mesh)  # -> V, A, B
item = ListItem(List=nakededge.V, Index=nakededge.A, Wrap=True)
item_2 = ListItem(List=nakededge.V, Index=nakededge.B, Wrap=True)
ln = Line(StartPoint=item, EndPoint=item_2)
join = JoinCurves(Curves=ln, Preserve=False)
explode = Explode(Curve=join, Recursive=True)  # -> Segments, Vertices

S = ClusterInput()

# ----
# Shift Lists
lng = ListLength(List=explode.Vertices)
divide = DivideCurve(Curve=project_2, Count=lng, Kinks=False)  # -> Points, Tangents, Parameters
cp = ClosestPoint(Point=P, Cloud=divide.Points)  # -> ClosestPoint, CPIndex, Distance
replace = ReplaceItems(List=divide.Points, Item=P, Indices=cp.CPIndex, Wrap=False)
shift = ShiftList(List=explode.Vertices, Shift=S, Wrap=True)

reset = ClusterInput()
on = ClusterInput()

edgelengths = EdgeLengths(Mesh=mplane.Mesh, LengthFactor=1, Strength=1)
anchor = Anchor(Point=shift, Target=replace, Strength=10000)
merge = Merge(Data1=edgelengths, Data2=anchor)  # -> simplify(Result)
solver = Solver(GoalObjects=merge, Reset=reset, Threshold=1e-15, Tolerance=0.01, On=on)  # -> I, V, O
clean = CleanTree(RemoveNulls=True, RemoveInvalid=True, RemoveEmpty=False, Tree=flatten(solver.O))

T = ClusterOutput(clean)

# ==== cluster Cluster
crv = ClusterInput()
crv_2 = ClusterInput()
crv_3 = Curve(crv)
crv_4 = Curve(crv_2)
len = Length(Curve=crv_3)
crv_5 = Curve(crv_3)
sort = SortList(Keys=len, ValuesA=crv_3)  # -> Keys, ValuesA
item = ListItem(List=sort.ValuesA, Index=0, Wrap=True)
cull_i = CullIndex(List=sort.ValuesA, Indices=0, Wrap=True)
len_2 = Length(Curve=item)
multiplication = Multiplication(A=len_2, B=Slider(0.4, range=0..1))
ext = ExtendCurve(Curve=reparameterize(item), Type=0, Start=expr("-x", multiplication), End=expr("-x", multiplication))
ccx = CurveCurve(CurveA=ext, CurveB=crv_4)  # -> Points, ParamsA, ParamsB
lng = ListLength(List=ccx.ParamsA)  # -> flatten(Length)
equals = Equality(FirstNumber=lng, SecondNumber=0)  # -> Equality, Inequality
cull = CullPattern(List=crv_4, CullPattern=equals.Inequality)
lng_2 = ListLength(List=cull)
reduce = RandomReduce(List=cull, Reduction=expr("x-1", lng_2), Seed=1)
ccx_2 = CurveCurve(CurveA=item, CurveB=reduce)  # -> Points, ParamsA, ParamsB
shatter = Shatter(Curve=item, Parameters=ccx_2.ParamsA)
shatter_2 = Shatter(Curve=reduce, Parameters=ccx_2.ParamsB)
panel = Panel("""0
1""")
eval = EvaluateCurve(Curve=reparameterize(shatter_2), Parameter=panel)  # -> Point, Tangent, Angle
crv_cp = CurveClosestPoint(Point=graft(eval.Point), Curve=crv_5)  # -> Point, Parameter, simplify(Distance)
crv_cp_2 = CurveClosestPoint(Point=eval.Point, Curve=item)  # -> Point, Parameter, Distance
sort_2 = SortList(Keys=crv_cp.Distance, ValuesA=crv_cp.Distance)  # -> Keys, ValuesA
item_2 = ListItem(List=sort_2.ValuesA, Index=0, Wrap=True)  # -> flatten(Item)
sort_3 = SortList(Keys=item_2, ValuesA=shatter_2)  # -> Keys, ValuesA
item_3 = ListItem(List=sort_3.ValuesA, Index=-1, Wrap=True)
merge = Merge(Data1=shatter, Data2=item_3, Data3=cull_i)  # -> flatten(Result)
R = ClusterOutput(merge)

# ==== cluster SeedNsimplify
geo = ClusterInput()
geo_2 = Geometry(geo)
offset = OffsetCurve(Curve=geo_2, Distance=expr("-x", Slider(0, range=0..10000)), Plane=PlaneXY(0, 0, 0), Corners=1)
explode = Explode(Curve=offset, Recursive=True)  # -> Segments, simplify(Vertices)
end = EndPoints(Curve=explode.Segments)  # -> Start, End
shift = ShiftList(List=explode.Segments, Shift=1, Wrap=True)
dprod = DotProduct(VectorA=unitize(explode.Segments), VectorB=unitize(shift), Unitize=False)  # -> simplify(DotProduct)
smaller = SmallerThan(FirstNumber=dprod, SecondNumber=Slider(0.918, range=0..1))  # -> SmallerThan, OrEqualTo
geo_3 = Geometry(graft(offset))
cull = CullPattern(List=end.End, CullPattern=smaller.SmallerThan)
crv_cp = CurveClosestPoint(Point=simplify(cull), Curve=reparameterize(geo_3))  # -> Point, simplify(Parameter), Distance
z = ClusterInput()
python = GhPythonScript(x=crv_cp.Parameter, y=Slider(1.39, range=0..10), z=z)  # -> out, a; inputs x: list
# ---------- python: Python ----------
__author__ = "Erik"
__version__ = "2019.03.06"

import rhinoscriptsyntax as rs
import ghpythonlib.components as gh
import random

t = x
fac = y
t.append(float(0))
t.append(float(1))
newT = gh.SortList(t,t)[1]
t = gh.SortList(t,t)[1]
b = t
for i in range(0, len(t)-1):
    thisT = t[i]
    nextT = t[i+1]
    diff = nextT-thisT
    if diff > 1/6:
        newT.append(thisT+diff/2)
t2 = gh.SortList(newT,newT)[1]
for i in range(0, len(t2)-1):
    thisT = t2[i]
    nextT = t2[i+1]
    diff = nextT-thisT
    if random.uniform(0,1)/fac < diff:
        newPt = random.normalvariate(1,0.1)*diff/2
        newT.append(thisT+newPt)
a = gh.SortList(newT,newT)[1]
# ---------- end python ----------
cull_i = CullIndex(List=python.a, Indices=0, Wrap=True)
eval = EvaluateCurve(Curve=reparameterize(geo_3), Parameter=cull_i)  # -> Point, Tangent, Angle
pline = PolyLine(Vertices=eval.Point, Closed=True)
pl = ClusterOutput(pline)

# ==== cluster GetRegions
num = ClusterInput()
crv = ClusterInput()
crv_2 = ClusterInput()
num_2 = Number(num)
crv_3 = Curve(crv)
crv_4 = Curve(crv_2)
neg = Negative(Value=num_2)
join = JoinCurves(Curves=crv_4, Preserve=False)
len = Length(Curve=crv_3)
merge = Merge(Data1=num_2, Data2=neg)
eval = EvaluateCurve(Curve=reparameterize(join), Parameter=graft([0, 1]))  # -> Point, unitize(Tangent), Angle
multiplication = Multiplication(A=eval.Tangent, B=len)
multiplication_2 = Multiplication(A=multiplication, B=graft([-1, 1]))
crv_cp = CurveClosestPoint(Point=eval.Point, Curve=crv_3)  # -> Point, Parameter, flatten(Distance)
smaller = SmallerThan(FirstNumber=crv_cp.Distance, SecondNumber=expr("0.01*x", len))  # -> SmallerThan, OrEqualTo
move = Move(Geometry=eval.Point, Motion=expr("0.05*x", multiplication_2))  # -> Geometry, Transform
ln = Line(StartPoint=eval.Point, EndPoint=move.Geometry)  # -> flatten(Line)
cull = CullPattern(List=ln, CullPattern=smaller.SmallerThan)
join_2 = JoinCurves(Curves=[cull, crv_4], Preserve=False)
offset = OffsetCurve(Curve=graft(join_2), Distance=merge, Plane=PlaneXY(0, 0, 0), Corners=1)  # -> simplify(Curve)
path_mapper = PathMapper(offset, source="{A;B}", target="{A}")
loft = Loft(Curves=path_mapper, Options={Adjust=False, Closed=False, LoftEnds=0, LoftSimp=0, LoftType=0, Rebuild=10, Refit=0.01})
debrep = DeconstructBrep(Brep=loft)  # -> Faces, Edges, Vertices
geo = Geometry(debrep.Edges)
join_3 = JoinCurves(Curves=geo, Preserve=False)
item = ListItem(List=join_3, Index=0, Wrap=True)  # -> flatten(Item)
runion = RegionUnion(Curves=item)
curvepoint = PointOnCurve(join_2, parameter=0.5)
rdiff = RegionDifference(CurvesA=crv_3, CurvesB=runion)
rint = RegionIntersection(CurvesA=crv_3, CurvesB=runion)
merge_2 = Merge(Data1=rdiff, Data2=rint)
incurve = PointInCurve(Point=curvepoint, Curve=graft(merge_2))  # -> Relationship, Point
ma = MassAddition(Input=incurve.Relationship)  # -> flatten(Result), PartialResults
dispatch = Dispatch(List=merge_2, DispatchPattern=ma.Result)  # -> ListA, ListB
A = ClusterOutput(dispatch.ListA)
B = ClusterOutput(dispatch.ListB)

# ==== cluster GetGridFromLines
line = ClusterInput()
line_2 = Line(line)
wbweave = WeaverbirdsMeshFromLinesWeaveBack(Lines=line_2, MaximumValence=4)
md = MeshDirection(Mesh=wbweave)
warpweft = WarpWeft(Mesh=md)  # -> Warp, Weft, NakedA, NakedB
cull = CullPattern(List=warpweft.Weft, CullPattern=invert(warpweft.NakedB))
cull_2 = CullPattern(List=warpweft.Warp, CullPattern=invert(warpweft.NakedA))
join = JoinCurves(Curves=cull_2, Preserve=False)
join_2 = JoinCurves(Curves=cull, Preserve=False)
crv = Curve(join)
crv_2 = ClusterOutput(crv)
crv_3 = Curve(join_2)
crv_4 = ClusterOutput(crv_3)
