# Grasshopper definition isRightMiddleLeft.gh (Grasshopper 0.9.76)

# ----
# Generate test file
number_slider = Slider(450, range=0..1000)
unit_z = UnitZ(Factor=1)
curve = Curve([<curve referenced from the Rhino model> x4])
divide_length = DivideLength(Curve=curve, Length=number_slider)  # -> Points, Tangents, Parameters
cross_product = CrossProduct(VectorA=divide_length.Tangents, VectorB=unit_z, Unitize=False)  # -> Vector, Length
multiplication = Multiplication(A=number_slider, B=cross_product.Vector)

# ---- group: Tangent vector
vector_display = VectorDisplay(Anchor=divide_length.Points, Vector=divide_length.Tangents)

# ---- group: Normal Vector
vector_display_2 = VectorDisplay(Anchor=divide_length.Points, Vector=multiplication)

# ----
# Inputs
# Based on the point positions and
# the normal vectors we need to tag
# the points with right, left or middle
tag_inputs = Panel("""Left
Middle
Right""")

# ---- group: Center points
data = Data(divide_length.Points)

# ---- group: Orientation
# We need a list of right, left or
# middle strings.. The list structure
# should be the same as the inputs
data_2 = Data(multiplication)

# ----
# Outputs
# Control
panel = Panel("Unknown")
text_tag = TextTag(Location=data, Text=panel)
